vi "BaffleCmd.gvi"   [LabVIEW NXG 4.0.0]
inputs:
  "task in": "DAQmx Task"
  "error in": error
  "BaffleCmd": "DAQmx Physical Channel" = "PXI"
  "BaffleUpACK": "DAQmx Physical Channel"
  "data": bool = TRUE
outputs:
  "error out": error
  "BaffleInPlace": bool
uses:
  NI::DAQmx::Internal::DAQmx Create Channel (DO-Digital Output).gvi
  NI::DAQmx::Internal::DAQmx Start Task.gvi
  NI::DAQmx::Internal::DAQmx Write (Digital Bool 1Line 1Point).gvi
  NI::DAQmx::Internal::DAQmx Clear Task.gvi
  NI::DAQmx::Internal::DAQmx Create Channel (DI-Digital Input).gvi
  NI::DAQmx::Internal::DAQmx Read (Digital Bool 1Line 1Point).gvi
diagram:
  call "DAQmx Create Channel (DO-Digital Output).gvi"(task in=$"task in", error in=$"error in", lines=$BaffleCmd) -> (task out=w1, error out=w2)
  call "DAQmx Start Task.gvi"(task in=w1, error in=w2) -> (task out=w3, error out=w4)
  for (N = 1) {
    call "DAQmx Write (Digital Bool 1Line 1Point).gvi"(task in=w3, error in=w4, data=$data) -> (task out=w5, error out=w6)
    call "DAQmx Clear Task.gvi"(task in=w5, error in=w6) -> (error out=w7)
  }
  case ($data) {
    frame False, Default {
      w8 = default
      w9 = default
    }
    frame True {
      for (N = 1) {
        call "DAQmx Create Channel (DI-Digital Input).gvi"(error in=w7, lines=$BaffleUpACK) -> (task out=w10, error out=w11)
        call "DAQmx Start Task.gvi"(task in=w10, error in=w11) -> (task out=w12, error out=w13)
        call "DAQmx Read (Digital Bool 1Line 1Point).gvi"(task in=w12, error in=w13) -> (task out=w9, error out=w8, data=w14)
        for (N = 1) {
          Wait(time to wait=5000)
        }
        $BaffleInPlace <- w14
      }
    }
  }
  call "DAQmx Clear Task.gvi"(task in=w9, error in=w8) -> (error out=w15)
  $"error out" <- w15
