vi "CRC convert to 2 bytes.gvi"   [LabVIEW NXG 4.0.0]
inputs:
  "Output": u16
outputs:
  "MSB": u16
  "LSB": u16
diagram:
  Logical Shift(x=$Output, y=-8) -> w1
  $MSB <- w1
  Logical And($Output, 255) -> w2
  $LSB <- w2
