vi "CRC-CCITT-16.gvi"   [LabVIEW NXG 4.0.0]
inputs:
  "CRC-CCITT Type": u16 = "CRC-16-CCITT (0xFFFF)"(65535)
  "Reset": bool
  "CRC In": u16
  "Data": u8
  "error in (no error)": error
outputs:
  "CRC": u16
  "error out": error
diagram:
  case ($"error in (no error)") {
    frame No Error {
      Select(s=$Reset, t=$"CRC-CCITT Type", f=$"CRC In") -> w3
      Split Number(x=w3) -> (high(x)=w4, low(x)=w5)
      # x
      Logical Exclusive Or(w4, $Data) -> w6
      # x = ((crc>>8) ^ data) & 0xff;
      # x ^= x>>4;
      Logical Shift(x=w6, y=-4) -> w7
      Logical Exclusive Or(w7, w6) -> w8
      # crc = (crc << 8) ^ (x << 12) ^ (x <<5) ^ x;
      # x
      Join Numbers(high(x)=0, low(x)=w8) -> w9
      Logical Shift(x=w9, y=5) -> w10
      Logical Shift(x=w9, y=12) -> w11
      Join Numbers(high(x)=w5, low(x)=0) -> w12
      # crc
      Logical Exclusive Or(w9, w10, w11, w12) -> w1
      w2 = $"error in (no error)"
    }
    frame Error {
      w1 = default
      w2 = $"error in (no error)"
    }
  }
  $CRC <- w1
  $"error out" <- w2
