vi "Calculate CRC.gvi"   [LabVIEW NXG 4.0.0]
inputs:
  "Head status_3": u8[]
outputs:
  "Output_2": u16
uses:
  Kirwan tester::CRC-CCITT-16.gvi
diagram:
  s1 = uninitialised  # shift register
  s2 = uninitialised  # shift register
  for (iteration -> i1) {
    w1 = each element of $"Head status_3"
    Is Equal To 0(x=i1) -> w2
    call "CRC-CCITT-16.gvi"(CRC-CCITT Type="CRC-16-CCITT (0xFFFF)"(65535), Reset=w2, CRC In=s2, Data=w1, error in (no error)=s1) -> (CRC=w3, error out=w4)
    next s1 = w4
    next s2 = w3
  }
  $Output_2 <- s2
