vi "CalculateMostInsensitiveCompliance.gvi"   [LabVIEW NXG 4.0.0]
inputs:
  "TestArray": bool[]
outputs:
  "CalibratedPulses": i32
diagram:
  Array Index(array=$TestArray) -> (out0[0]=w1, out1[4]=w2, out2[8]=w3)
  Build Array(w1, w2, w3) -> w4
  Boolean Array To Number(Boolean array=w4) -> (number=w5)
  Is Equal(x=w5, y=7) -> w6
  Array Index(array=$TestArray) -> (out0[1]=w7, out1[5]=w8, out2[9]=w9)
  Build Array(w7, w8, w9) -> w10
  Boolean Array To Number(Boolean array=w10) -> (number=w11)
  Is Equal(x=w11, y=7) -> w12
  Array Index(array=$TestArray) -> (out0[2]=w13, out1[6]=w14, out2[10]=w15)
  Build Array(w13, w14, w15) -> w16
  Boolean Array To Number(Boolean array=w16) -> (number=w17)
  Is Equal(x=w17, y=7) -> w18
  Array Index(array=$TestArray) -> (out0[3]=w19, out1[7]=w20, out2[11]=w21)
  Build Array(w19, w20, w21) -> w22
  Boolean Array To Number(Boolean array=w22) -> (number=w23)
  Is Equal(x=w23, y=7) -> w24
  Build Array(w6, w12, w18, w24) -> w25
  Array Index(array=w25) -> (out0[0]=w26, out1[1]=w27, out2[2]=w28, out3[3]=w29)
  case (w29) {
    frame False, Default {
      w30 = 10
    }
    frame True {
      w30 = 3
    }
  }
  case (w26) {
    frame False, Default {
      w31 = 10
    }
    frame True {
      w31 = 6
    }
  }
  case (w27) {
    frame False, Default {
      w32 = 10
    }
    frame True {
      w32 = 5
    }
  }
  case (w28) {
    frame False, Default {
      w33 = 10
    }
    frame True {
      w33 = 4
    }
  }
  Build Array(w31, w32, w33, w30) -> w34
  Array Max And Min(array=w34) -> (min value=w35)
  Is Greater Than 0(x=w35) -> w36
  case (w36) {
    frame False, Default {
      w37 = default
    }
    frame True {
      w37 = w35
    }
  }
  $CalibratedPulses <- w37
