vi "CommslinkCheck.gvi"   [LabVIEW NXG 4.0.0]
inputs:
  "session in": "VISA Instr"
  "error in": error
outputs:
  "session out": "VISA Instr"
  "error out": error
  "CommsLINK Result": bool
  "read buffer": u8[]
uses:
  NI::VISA::Write (Instr, Bytes).gvi
  NI::VISA::Read (Instr, Bytes).gvi
diagram:
  call "Write (Instr, Bytes).gvi"(session in=$"session in", error in=$"error in", write buffer=[0, 85, 3, 210, 10, 207]) -> (session out=w1, error out=w2)
  call "Read (Instr, Bytes).gvi"(session in=w1, error in=w2, byte count=6) -> (session out=w3, error out=w4, read buffer=w5)
  $"session out" <- w3
  $"error out" <- w4
  $"read buffer" <- w5
  Array Index(array=w5) -> (out0[4]=w6)
  Is Equal(x=w6, y=1) -> w7
  $"CommsLINK Result" <- w7
