vi "ConditioningCalibrationArray.gvi"   [LabVIEW NXG 4.0.0]
inputs:
  "read buffer": string
outputs:
  "CalibrationArray": i32[]
uses:
  NI::G Core::Strings::Delimited String to 1D String Array.gvi
diagram:
  Search Or Split String(search string/char="Detection", string=$"read buffer") -> (match + rest of string=w1)
  call "Delimited String to 1D String Array.gvi"(delimited string=w1, delimiter=":") -> (string array=w2)
  Array Index(array=w2) -> (out0[1]=w3)
  call "Delimited String to 1D String Array.gvi"(delimited string=w3, delimiter=",") -> (string array=w4)
  Decimal String To Number(string=w4) -> (number=w5)
  Array Subset(array=w5, index0=1) -> w6
  $CalibrationArray <- w6
