vi "Confirm test mode entry ack.gvi"   [LabVIEW NXG 4.0.0]
inputs:
  "error in": error
  "session in": "VISA Instr"
outputs:
  "session out": "VISA Instr"
  "error out": error
  "logical AND": bool
  "read buffer": u8[]
panel indicators:
  "index of element": i32
uses:
  NI::VISA::Read (Instr, Bytes).gvi
diagram:
  Property Node(instance in=$"session in", error in=$"error in") -> ("ASRL Bytes at Port"=w1, error out=w2, instance out=w3)
  call "Read (Instr, Bytes).gvi"(session in=w3, error in=w2, byte count=w1) -> (session out=w4, error out=w5, read buffer=w6)
  $"session out" <- w4
  $"error out" <- w5
  $"read buffer" <- w6
  Search 1D Array(1D array=w6, element=0xFF) -> (index of element=w7)
  $"index of element" <- w7
  Is Greater(x=w7, y=0) -> w8
  $"logical AND" <- w8
