vi "DebugArrayPanel.gvi"   [LabVIEW NXG 4.0.0]
panel controls:
  "UART COM": "VISA Instr" = "COM3"
  "lines": "DAQmx Physical Channel" = "Dev1/port0/line1"
  "Object to 45cm position (DevX/Port0/Line3)_2": "DAQmx Physical Channel" = "Dev1/port0/line3"
  "Bed of nails": "DAQmx Physical Channel" = "Dev1/port0/line1"
  "Device reset": "DAQmx Physical Channel" = "Dev1/port0/line2"
  "pass flags": bool = TRUE
  "Button": bool
  "stop": bool
  "Pulses": i32
  "Switch on": i32
panel indicators:
  "subarray": u8[]
  "error out": error
  "User ID": u8[]
  "User ID Recieved": bool
  "Test Mode ACK": bool
  "loop iteration": i32
  "read buffer_2": u8[]
  "Pass Flag result": string
  "Test Cycle Time": f64
  "CommsLINK Result": bool
  "Test in progress": bool
  "Graph": i32[]
uses:
  NI::VISA::Open (Instr).gvi
  NI::VISA::Configure Serial Port (Instr).gvi
  NI::VISA::Flush Buffer (Instr).gvi
  Kirwan tester::bring down bed of nails.gvi
  NI::DAQmx::Internal::DAQmx Clear Task.gvi
  NI::DAQmx::Internal::DAQmx Create Channel (DO-Digital Output).gvi
  NI::DAQmx::Internal::DAQmx Start Task.gvi
  Kirwan tester::PLCCommand.gvi
  Kirwan tester::bring up bed of nails.gvi
  Kirwan tester::reset device.gvi
  NI::VISA::Read (Instr, Bytes).gvi
  NI::G Core::Error::Filter Error Code.gvi
  NI::VISA::Write (Instr, Bytes).gvi
  Kirwan tester::Confirm test mode entry ack.gvi
  Kirwan tester::Calculate CRC.gvi
  Kirwan tester::CRC convert to 2 bytes.gvi
  NI::VISA::Read (Instr, String).gvi
  Kirwan tester::ObjectArray.gvi
diagram:
  while {
    for (N = 1) {
      call "Open (Instr).gvi"(resource name=$"UART COM") -> (session out=w1, error out=w2)
      call "Configure Serial Port (Instr).gvi"(session in=w1, error in=w2, baud rate=19200, timeout=10000, enable termination char=FALSE) -> (session out=w3, error out=w4)
      call "Flush Buffer (Instr).gvi"(session in=w3, error in=w4, mode="Discard Receive and Transmit Buffers"(192)) -> (session out=w5, error out=w6)
      while (iteration -> i1) {
        Is Equal To 0(x=i1) -> w7
        case (w7) {
          frame False, Default {
            w8 = w6
          }
          frame True {
            call "bring down bed of nails.gvi"(lines=$lines) -> (task out=w9)
            call "DAQmx Clear Task.gvi"(task in=w9, error in=w6) -> (error out=w8)
            call "DAQmx Create Channel (DO-Digital Output).gvi"(lines=$"Object to 45cm position (DevX/Port0/Line3)_2") -> (task out=w10, error out=w11)
            call "DAQmx Start Task.gvi"(task in=w10, error in=w11) -> (task out=w12, error out=w13)
            call "PLCCommand.gvi"(task out=w12, error out=w13) -> (Output=w14, Output_2=w15)
            call "DAQmx Clear Task.gvi"(task in=w14, error in=w15)
          }
        }
        case ($Button) {
          frame False, Default {
            w16 = w8
          }
          frame True {
            call "bring up bed of nails.gvi"(Physical Channel reference=$"Bed of nails") -> (task out=w17, error out=w18)
            for (N = 1) {
              call "DAQmx Clear Task.gvi"(task in=w17)
              Wait(time to wait=2000)
            }
            call "reset device.gvi"(error in=w18, Physical Channel reference=$"Device reset") -> (task out=w19, error out=w20)
            call "DAQmx Clear Task.gvi"(task in=w19, error in=w20) -> (error out=w16)
            $subarray <- u8[] []
          }
        }
        Property Node(instance in=w5) -> ("ASRL Bytes at Port"=w21, instance out=w22)
        Is Greater(x=w21, y=10) -> w23
        case (w23) {
          frame False, Default {
            w24 = default
            w25 = w16
            w26 = w22
            w27 = default
            w28 = default
          }
          frame True {
            call "Read (Instr, Bytes).gvi"(session in=w22, error in=w16, byte count=12) -> (session out=w29, error out=w30, read buffer=w31)
            $"error out" <- w30
            Array Size(array=w31) -> (size(s)=w32)
            Is Greater Or Equal(x=w32, y=4) -> w24
            call "Filter Error Code.gvi"(error in=w30, code to clear=-1073807298) -> (error out=w33)
            case (w24) {
              frame False, Default {
                w25 = w33
                w26 = w29
                w27 = default
              }
              frame True {
                call "Write (Instr, Bytes).gvi"(session in=w29, error in=w33, write buffer=[0, 85, 3, 84, 251, 129]) -> (session out=w26, error out=w25)
                Get Current Time() -> (current time=w27)
              }
            }
            $"User ID" <- w31
            w28 = $"pass flags"
          }
        }
        call "Filter Error Code.gvi"(error in=w25, code to clear=-1073807253) -> (error out=w34)
        $"User ID Recieved" <- w24
        stop if w24
      }
      case (w24) {
        frame False, Default {
          w35 = default
          w36 = default
        }
        frame True {
          call "Filter Error Code.gvi"(error in=w34, code to clear=-1073807298) -> (error out=w37)
          case (TRUE) {
            frame False, Default {
              w38 = default
              w39 = default
            }
            frame True {
              for (N = 1) {
                Wait(time to wait=300)
              }
              w38 = w37
              w39 = w26
            }
          }
          while (iteration -> i2) {
            call "Confirm test mode entry ack.gvi"(error in=w38, session in=w39) -> (session out=w36, error out=w35, logical AND=w40, read buffer=w41)
            $"read buffer_2" <- w41
            $"Test Mode ACK" <- w40
            Is Greater Than 0(x=i2) -> w42
            Logical Or(w40, w42) -> w43
            case (w43) {
              frame False, Default {
                w44 = default
              }
              frame True {
                w44 = w40
              }
            }
            $"loop iteration" <- i2
            stop if w43
          }
          $"CommsLINK Result" <- FALSE
          $"Test in progress" <- TRUE
          $"Pass Flag result" <- ""
          $"Test Cycle Time" <- 0
        }
      }
      while {
        Build Array(0x0, 0x55, 0xA, 0x58, $Pulses, 0x28, 0xA, $"Switch on", 0x4, 0x1, 144) -> w45
        Array Subset(array=w45, index0=3) -> w46
        call "Calculate CRC.gvi"(Head status_3=w46) -> (Output_2=w47)
        call "CRC convert to 2 bytes.gvi"(Output=w47) -> (MSB=w48, LSB=w49)
        Build Array(w45, w48, w49) -> w50
        call "Write (Instr, Bytes).gvi"(session in=w36, error in=w35, write buffer=w50) -> (session out=w51, error out=w52)
        case (TRUE) {
          frame False, Default {
            w53 = default
            w54 = default
          }
          frame True {
            Wait(time to wait=1200)
            w53 = w51
            w54 = w52
          }
        }
        Property Node(instance in=w53, error in=w54) -> ("ASRL Bytes at Port"=w55, error out=w56, instance out=w57)
        call "Read (Instr, String).gvi"(session in=w57, error in=w56, byte count=w55) -> (read buffer=w58)
        call "ObjectArray.gvi"(read buffer=w58) -> (Object Array=w59)
        $Graph <- w59
        Wait(time to wait=800)
        w60 = $stop
        stop if w60
      }
    }
    stop if w60
  }
