vi "EEPROMWriteDecayTime.gvi"   [LabVIEW NXG 4.0.0]
inputs:
  "session in": "VISA Instr"
  "error in": error
  "decay time": u8 = 8
outputs:
  "session out": "VISA Instr"
  "error out": error
  "read buffer": u8[]
uses:
  Kirwan tester::Calculate CRC.gvi
  Kirwan tester::CRC convert to 2 bytes.gvi
  NI::VISA::Write (Instr, Bytes).gvi
  NI::VISA::Read (Instr, Bytes).gvi
diagram:
  Build Array([60, 252, 1], $"decay time") -> w1
  call "Calculate CRC.gvi"(Head status_3=w1) -> (Output_2=w2)
  call "CRC convert to 2 bytes.gvi"(Output=w2) -> (MSB=w3, LSB=w4)
  Build Array(w1, w3, w4) -> w5
  Array Size(array=w5) -> (size(s)=w6)
  Build Array([0, 85], w6, w5) -> w7
  call "Write (Instr, Bytes).gvi"(session in=$"session in", error in=$"error in", write buffer=w7) -> (session out=w8, error out=w9)
  for (N = 1) {
    Wait(time to wait=1000)
  }
  Property Node(instance in=w8, error in=w9) -> ("ASRL Bytes at Port"=w10, error out=w11, instance out=w12)
  call "Read (Instr, Bytes).gvi"(session in=w12, error in=w11, byte count=w10) -> (session out=w13, error out=w14, read buffer=w15)
  $"session out" <- w13
  $"error out" <- w14
  $"read buffer" <- w15
