vi "EEPROMWriteNumberOfPulses.gvi"   [LabVIEW NXG 4.0.0]
inputs:
  "session in": "VISA Instr"
  "error in": error
  "Numeric Constant_3": u8 = 8
  "Numeric Constant_2": u8 = 8
  "Numeric Constant": u8 = 8
outputs:
  "session out": "VISA Instr"
  "error out": error
  "read buffer": u8[]
uses:
  Kirwan tester::Calculate CRC.gvi
  Kirwan tester::CRC convert to 2 bytes.gvi
  NI::VISA::Write (Instr, Bytes).gvi
  NI::VISA::Read (Instr, Bytes).gvi
diagram:
  Build Array($"Numeric Constant_3", $"Numeric Constant_2", $"Numeric Constant") -> w1
  Build Array([60, 56, 3], w1) -> w2
  call "Calculate CRC.gvi"(Head status_3=w2) -> (Output_2=w3)
  call "CRC convert to 2 bytes.gvi"(Output=w3) -> (MSB=w4, LSB=w5)
  Build Array(w2, w4, w5) -> w6
  Array Size(array=w6) -> (size(s)=w7)
  Build Array([0, 85], w7, w6) -> w8
  call "Write (Instr, Bytes).gvi"(session in=$"session in", error in=$"error in", write buffer=w8) -> (session out=w9, error out=w10)
  for (N = 1) {
    Wait(time to wait=1000)
  }
  Property Node(instance in=w9, error in=w10) -> ("ASRL Bytes at Port"=w11, error out=w12, instance out=w13)
  call "Read (Instr, Bytes).gvi"(session in=w13, error in=w12, byte count=w11) -> (session out=w14, error out=w15, read buffer=w16)
  $"session out" <- w14
  $"error out" <- w15
  $"read buffer" <- w16
