vi "EEPROMWriteTestArray.gvi"   [LabVIEW NXG 4.0.0]
inputs:
  "session in": "VISA Instr"
  "error in": error
  "TestArrayIn": u16
outputs:
  "session out": "VISA Instr"
  "error out": error
  "read buffer": u8[]
uses:
  Kirwan tester::Calculate CRC.gvi
  Kirwan tester::CRC convert to 2 bytes.gvi
  NI::VISA::Write (Instr, Bytes).gvi
  NI::VISA::Read (Instr, Bytes).gvi
diagram:
  Logical Shift(x=$TestArrayIn, y=-8) -> w1
  Logical And($TestArrayIn, 255) -> w2
  Build Array(w1, w2) -> w3
  Build Array([60, 174, 2], w3) -> w4
  call "Calculate CRC.gvi"(Head status_3=w4) -> (Output_2=w5)
  call "CRC convert to 2 bytes.gvi"(Output=w5) -> (MSB=w6, LSB=w7)
  Build Array(w4, w6, w7) -> w8
  Array Size(array=w8) -> (size(s)=w9)
  Build Array([0, 85], w9, w8) -> w10
  call "Write (Instr, Bytes).gvi"(session in=$"session in", error in=$"error in", write buffer=w10) -> (session out=w11, error out=w12)
  for (N = 1) {
    Wait(time to wait=1000)
  }
  Property Node(instance in=w11, error in=w12) -> ("ASRL Bytes at Port"=w13, error out=w14, instance out=w15)
  call "Read (Instr, Bytes).gvi"(session in=w15, error in=w14, byte count=w13) -> (session out=w16, error out=w17, read buffer=w18)
  $"session out" <- w16
  $"error out" <- w17
  $"read buffer" <- w18
