vi "ExitTestMode.gvi"   [LabVIEW NXG 4.0.0]
inputs:
  "session in": "VISA Instr"
  "error in": error
outputs:
  "session out": "VISA Instr"
  "error out": error
  "read buffer": u8[]
uses:
  NI::VISA::Write (Instr, Bytes).gvi
  NI::VISA::Read (Instr, Bytes).gvi
  NI::G Core::Error::Clear Error Cluster.gvi
diagram:
  call "Write (Instr, Bytes).gvi"(session in=$"session in", error in=$"error in", write buffer=[0, 85, 3, 85, 235, 160]) -> (session out=w1, error out=w2)
  for (N = 1) {
    Wait(time to wait=1000)
  }
  Property Node(instance in=w1, error in=w2) -> ("ASRL Bytes at Port"=w3, error out=w4, instance out=w5)
  call "Read (Instr, Bytes).gvi"(session in=w5, error in=w4, byte count=w3) -> (session out=w6, error out=w7, read buffer=w8)
  $"session out" <- w6
  call "Clear Error Cluster.gvi"(error in=w7) -> (error out=w9)
  $"error out" <- w9
  $"read buffer" <- w8
