vi "Function.gvi"   [LabVIEW NXG 4.0.0]
panel indicators:
  "appended array": i32[]
  "5 pulse constant": i32[]
  "4 pulses constant": i32[]
  "3 pulses constant": i32[]
  "6 pulses constant": i32[]
  "ringing 6": i32[]
  "ringing 5": i32[]
  "ringing 4": i32[]
  "ringing 3": i32[]
uses:
  Kirwan tester::Calculate CRC.gvi
  Kirwan tester::CRC convert to 2 bytes.gvi
diagram:
  Build Array(0x0, 0x55, 0xA, 0x58, 3, 0x28, 0x10, 0x17, 0x4, 0x1, 144)
  Array Subset(array=[0, 85, 10, 88, 3, 40, 16, 24, 4, 1, 144], index0=3) -> w1
  call "Calculate CRC.gvi"(Head status_3=w1) -> (Output_2=w2)
  call "CRC convert to 2 bytes.gvi"(Output=w2) -> (MSB=w3, LSB=w4)
  Build Array([0, 85, 10, 88, 3, 40, 16, 24, 4, 1, 144], w3, w4) -> w5
  $"appended array" <- w5
