vi "Function_3.gvi"   [LabVIEW NXG 4.0.0]
panel controls:
  "pass flags": bool = TRUE
  "stop": bool
panel indicators:
  "too few bytes": bool
  "error out": error
  "User ID_2": u8[]
  "Output": bool
  "index of element": i32
  "Test Mode ACK": bool
  "loop iteration": i32
  "read buffer_2": u8[]
  "TestModeACK": error
  "Ringing_2": bool[]
  "Far Field": bool[]
  "Near Field": bool[]
  "Ringing": i32[][]
  "Objects @ 25 and 45cm": i32[][]
  "Object @ 11cm": i32[][]
uses:
  NI::VISA::Open (Instr).gvi
  NI::VISA::Configure Serial Port (Instr).gvi
  NI::VISA::Flush Buffer (Instr).gvi
  NI::VISA::Read (Instr, Bytes).gvi
  NI::G Core::Error::Filter Error Code.gvi
  NI::VISA::Write (Instr, Bytes).gvi
  Kirwan tester::Confirm test mode entry ack.gvi
diagram:
  while {
    call "Open (Instr).gvi"(resource name="COM43") -> (session out=w1, error out=w2)
    call "Configure Serial Port (Instr).gvi"(session in=w1, error in=w2, baud rate=19200) -> (session out=w3, error out=w4)
    call "Flush Buffer (Instr).gvi"(session in=w3, error in=w4, mode="Discard Receive and Transmit Buffers"(192)) -> (session out=w5, error out=w6)
    while {
      Property Node(instance in=w5, error in=w6) -> ("ASRL Bytes at Port"=w7, error out=w8, instance out=w9)
      Is Greater(x=w7, y=10) -> w10
      case (w10) {
        frame False, Default {
          $"too few bytes" <- TRUE
          w11 = w8
          w12 = w9
          w13 = default
          w14 = FALSE
          w15 = FALSE
          w16 = FALSE
        }
        frame True {
          call "Read (Instr, Bytes).gvi"(session in=w9, error in=w8, byte count=w7) -> (session out=w17, error out=w18, read buffer=w19)
          $"error out" <- w18
          Search 1D Array(1D array=w19, element=0x3A) -> (index of element=w20)
          Is Greater(x=w20, y=0) -> w14
          call "Filter Error Code.gvi"(error in=w18, code to clear=-1073807298) -> (error out=w21)
          case (w14) {
            frame False, Default {
              w11 = w21
              w12 = w17
              w22 = default
            }
            frame True {
              call "Write (Instr, Bytes).gvi"(session in=w17, error in=w21, write buffer=[0, 85, 3, 84, 251, 129]) -> (session out=w12, error out=w11)
              Get Current Time() -> (current time=w22)
            }
          }
          $"User ID_2" <- w19
          $"index of element" <- w20
          w13 = $"pass flags"
          w15 = w14
          w16 = w14
        }
      }
      $Output <- w16
      stop if w15
    }
    case (w14) {
      frame False, Default { }
      frame True {
        for (N = 1) {
          Wait(time to wait=400)
        }
        while (iteration -> i1) {
          call "Confirm test mode entry ack.gvi"(error in=w11, session in=w12) -> (session out=w23, error out=w24, logical AND=w25, read buffer=w26)
          $TestModeACK <- w24
          $"read buffer_2" <- w26
          $"Test Mode ACK" <- w25
          Is Greater Than 0(x=i1) -> w27
          Logical Or(w25, w27) -> w28
          case (w28) {
            frame False, Default {
              w29 = default
            }
            frame True {
              w29 = w25
            }
          }
          Get Current Time() -> (current time=w30)
          $"loop iteration" <- i1
          stop if w28
        }
        $Ringing_2 <- [FALSE, FALSE, FALSE, FALSE]
        $"Far Field" <- [FALSE, FALSE, FALSE, FALSE]
        $"Near Field" <- [FALSE, FALSE, FALSE, FALSE]
        $Ringing <- i32[][] []
        $"Objects @ 25 and 45cm" <- i32[][] []
        $"Object @ 11cm" <- i32[][] []
      }
    }
    stop if $stop
  }
