vi "Generate .csv file from timestamp.gvi"   [LabVIEW NXG 4.0.0]
inputs:
  "File Path": path = path "\\EI-Data1\\Users\\JoeDaly\\Desktop"
outputs:
  "Output": ByteStreamFileRefnum
  "error out": error
diagram:
  Get Current Time() -> (current time=w1)
  Format Date Time String(time format string (%c)="%d%m%y_%H%M%S", time stamp=w1) -> (date/time string=w2)
  Concatenate Strings(w2, ".csv") -> w3
  Build Path(base path=$"File Path", name or relative path=w3) -> (appended path=w4)
  Open Or Create Or Replace File(access (0:read/write)="read/write", file path (use dialog)=w4, operation (0:open)="open or create") -> (error out=w5, refnum out=w6)
  w7 = "APP Version,DateTime,Serial Number (Head),Test Status,Cycle Time, Ringing Time(ms),Calibrated Pulses, Test Value, ZeroCal, Smoke Cal"
  Concatenate Strings(w7, "\r\n") -> w8
  Write To Text File(error in=w5, file (use dialog)=w6, text=w8) -> (error out=w9, refnum out=w10)
  $Output <- w10
  $"error out" <- w9
