vi "Measure11CmObject.gvi"   [LabVIEW NXG 4.0.0]
inputs:
  "session in": "VISA Instr"
  "error in": error
outputs:
  "Object3 pulses11cm": i32[]
  "Object4 pulses11cm": i32[]
  "session out": "VISA Instr"
  "Object6 pulses11 cm": i32[]
  "Object5 pulses11 cm": i32[]
  "11cm": bool[]
  "Stop": bool
  "error out": error
uses:
  NI::VISA::Write (Instr, Bytes).gvi
  NI::VISA::Read (Instr, String).gvi
  Kirwan tester::ObjectArray.gvi
  NI::VISA::Flush Buffer (Instr).gvi
  Kirwan tester::NumberOfPointsOver400.gvi
diagram:
  call "Write (Instr, Bytes).gvi"(session in=$"session in", error in=$"error in", write buffer=[0, 85, 10, 88, 6, 40, 16, 27, 4, 1, 144, 16, 69]) -> (session out=w1, error out=w2)
  case (TRUE) {
    frame False, Default {
      w3 = default
      w4 = default
    }
    frame True {
      Wait(time to wait=1100)
      w3 = w1
      w4 = w2
    }
  }
  Property Node(instance in=w3, error in=w4) -> ("ASRL Bytes at Port"=w5, error out=w6, instance out=w7)
  call "Read (Instr, String).gvi"(session in=w7, error in=w6, byte count=w5) -> (session out=w8, error out=w9, read buffer=w10)
  call "ObjectArray.gvi"(read buffer=w10) -> (Object Array=w11)
  Array Subset(array=w11, index0=1) -> w12
  $"Object6 pulses11 cm" <- w12
  call "Write (Instr, Bytes).gvi"(session in=w8, error in=w9, write buffer=[0, 85, 10, 88, 5, 40, 16, 27, 4, 1, 144, 200, 199]) -> (session out=w13, error out=w14)
  case (TRUE) {
    frame False, Default {
      w15 = default
      w16 = default
    }
    frame True {
      Wait(time to wait=1100)
      w15 = w13
      w16 = w14
    }
  }
  Property Node(instance in=w15, error in=w16) -> ("ASRL Bytes at Port"=w17, error out=w18, instance out=w19)
  call "Read (Instr, String).gvi"(session in=w19, error in=w18, byte count=w17) -> (session out=w20, error out=w21, read buffer=w22)
  call "Write (Instr, Bytes).gvi"(session in=w20, error in=w21, write buffer=[0, 85, 10, 88, 4, 40, 16, 27, 4, 1, 144, 112, 166]) -> (session out=w23, error out=w24)
  case (TRUE) {
    frame False, Default {
      w25 = default
      w26 = default
    }
    frame True {
      Wait(time to wait=1100)
      w25 = w23
      w26 = w24
    }
  }
  Property Node(instance in=w25, error in=w26) -> ("ASRL Bytes at Port"=w27, error out=w28, instance out=w29)
  call "Read (Instr, String).gvi"(session in=w29, error in=w28, byte count=w27) -> (session out=w30, error out=w31, read buffer=w32)
  call "Write (Instr, Bytes).gvi"(session in=w30, error in=w31, write buffer=[0, 85, 10, 88, 3, 40, 16, 27, 4, 1, 144, 105, 226]) -> (session out=w33, error out=w34)
  case (TRUE) {
    frame False, Default {
      w35 = default
      w36 = default
    }
    frame True {
      Wait(time to wait=1100)
      w35 = w33
      w36 = w34
    }
  }
  Property Node(instance in=w35, error in=w36) -> ("ASRL Bytes at Port"=w37, error out=w38, instance out=w39)
  call "Read (Instr, String).gvi"(session in=w39, error in=w38, byte count=w37) -> (session out=w40, error out=w41, read buffer=w42)
  call "Flush Buffer (Instr).gvi"(session in=w40, error in=w41, mode="Discard Receive and Transmit Buffers"(192)) -> (session out=w43, error out=w44)
  $"session out" <- w43
  $"error out" <- w44
  call "ObjectArray.gvi"(read buffer=w22) -> (Object Array=w45)
  # Is object detected @ 11cm with 5 pulses
  Array Subset(array=w45, index0=1) -> w46
  $"Object5 pulses11 cm" <- w46
  call "ObjectArray.gvi"(read buffer=w32) -> (Object Array=w47)
  Array Subset(array=w47, index0=1) -> w48
  # Is object detected @ 11cm with 4 pulses
  $"Object4 pulses11cm" <- w48
  call "ObjectArray.gvi"(read buffer=w42) -> (Object Array=w49)
  Array Subset(array=w49, index0=1) -> w50
  # Is object detected @ 11cm with 3 pulses
  $"Object3 pulses11cm" <- w50
  # Is object detected @ 11cm with 6 pulses
  Array Subset(array=w12, length0=10) -> w51
  call "NumberOfPointsOver400.gvi"(array_2=w51) -> (NumberOfPointsOverThreshold_2=w52)
  Is Greater Or Equal(x=w52, y=4) -> w53
  Array Subset(array=w46, length0=10) -> w54
  call "NumberOfPointsOver400.gvi"(array_2=w54) -> (NumberOfPointsOverThreshold_2=w55)
  Is Greater Or Equal(x=w55, y=4) -> w56
  Array Subset(array=w48, length0=10) -> w57
  call "NumberOfPointsOver400.gvi"(array_2=w57) -> (NumberOfPointsOverThreshold_2=w58)
  Is Greater Or Equal(x=w58, y=4) -> w59
  Array Subset(array=w50, length0=10) -> w60
  call "NumberOfPointsOver400.gvi"(array_2=w60) -> (NumberOfPointsOverThreshold_2=w61)
  Is Greater Or Equal(x=w61, y=4) -> w62
  Build Array(w53, w56, w59, w62) -> w63
  $"11cm" <- w63
  Is Equal(x=w62, y=FALSE) -> w64
  Is Equal(x=w62, y=TRUE) -> w65
  Logical Or(w64, w65) -> w66
  $Stop <- w66
