vi "MeasureFarFieldObjects.gvi"   [LabVIEW NXG 4.0.0]
inputs:
  "session in": "VISA Instr"
  "error in": error
outputs:
  "Object5pulsesFarField": i32[]
  "Object4pulsesFarField": i32[]
  "Object6pulsesFarField": i32[]
  "Object3pulsesFarField": i32[]
  "Far Field": bool[]
  "error out": error
  "session out": "VISA Instr"
  "Echoes for text file far field": string
uses:
  NI::VISA::Write (Instr, Bytes).gvi
  NI::VISA::Read (Instr, String).gvi
  Kirwan tester::ObjectArray.gvi
  Kirwan tester::NumberOfPointsOver200.gvi
diagram:
  call "Write (Instr, Bytes).gvi"(session in=$"session in", error in=$"error in", write buffer=[0, 85, 10, 88, 6, 40, 16, 27, 4, 1, 144, 16, 69]) -> (session out=w1, error out=w2)
  case (TRUE) {
    frame False, Default {
      w3 = default
      w4 = default
    }
    frame True {
      Wait(time to wait=1100)
      w3 = w1
      w4 = w2
    }
  }
  Property Node(instance in=w3, error in=w4) -> ("ASRL Bytes at Port"=w5, error out=w6, instance out=w7)
  call "Read (Instr, String).gvi"(session in=w7, error in=w6, byte count=w5) -> (session out=w8, error out=w9, read buffer=w10)
  call "ObjectArray.gvi"(read buffer=w10) -> (Object Array=w11)
  Array Subset(array=w11, index0=1) -> w12
  Number To Decimal String(number=w12, width (-)=4) -> (decimal integer string=w13)
  call "Write (Instr, Bytes).gvi"(session in=w8, error in=w9, write buffer=[0, 85, 10, 88, 5, 40, 16, 27, 4, 1, 144, 200, 199]) -> (session out=w14, error out=w15)
  case (TRUE) {
    frame False, Default {
      w16 = default
      w17 = default
    }
    frame True {
      Wait(time to wait=1100)
      w16 = w14
      w17 = w15
    }
  }
  Property Node(instance in=w16, error in=w17) -> ("ASRL Bytes at Port"=w18, error out=w19, instance out=w20)
  call "Read (Instr, String).gvi"(session in=w20, error in=w19, byte count=w18) -> (session out=w21, error out=w22, read buffer=w23)
  call "ObjectArray.gvi"(read buffer=w23) -> (Object Array=w24)
  Array Subset(array=w24, index0=1) -> w25
  Number To Decimal String(number=w25, width (-)=4) -> (decimal integer string=w26)
  call "Write (Instr, Bytes).gvi"(session in=w21, error in=w22, write buffer=[0, 85, 10, 88, 4, 40, 16, 27, 4, 1, 144, 112, 166]) -> (session out=w27, error out=w28)
  case (TRUE) {
    frame False, Default {
      w29 = default
      w30 = default
    }
    frame True {
      Wait(time to wait=1100)
      w29 = w27
      w30 = w28
    }
  }
  Property Node(instance in=w29, error in=w30) -> ("ASRL Bytes at Port"=w31, error out=w32, instance out=w33)
  call "Read (Instr, String).gvi"(session in=w33, error in=w32, byte count=w31) -> (session out=w34, error out=w35, read buffer=w36)
  call "ObjectArray.gvi"(read buffer=w36) -> (Object Array=w37)
  Array Subset(array=w37, index0=1) -> w38
  Number To Decimal String(number=w38, width (-)=4) -> (decimal integer string=w39)
  call "Write (Instr, Bytes).gvi"(session in=w34, error in=w35, write buffer=[0, 85, 10, 88, 3, 40, 16, 27, 4, 1, 144, 105, 226]) -> (session out=w40, error out=w41)
  case (TRUE) {
    frame False, Default {
      w42 = default
      w43 = default
    }
    frame True {
      Wait(time to wait=1100)
      w42 = w40
      w43 = w41
    }
  }
  Property Node(instance in=w42, error in=w43) -> ("ASRL Bytes at Port"=w44, error out=w45, instance out=w46)
  call "Read (Instr, String).gvi"(session in=w46, error in=w45, byte count=w44) -> (session out=w47, error out=w48, read buffer=w49)
  call "ObjectArray.gvi"(read buffer=w49) -> (Object Array=w50)
  Array Subset(array=w50, index0=1) -> w51
  Number To Decimal String(number=w51, width (-)=4) -> (decimal integer string=w52)
  Concatenate Strings(w13, "\t", w26, "\t", w39, "\t", w52) -> w53
  $"Echoes for text file far field" <- w53
  $Object5pulsesFarField <- w25
  $Object4pulsesFarField <- w38
  $Object6pulsesFarField <- w12
  $Object3pulsesFarField <- w51
  $"session out" <- w47
  $"error out" <- w48
  Array Subset(array=w12, index0=9, length0=8) -> w54
  call "NumberOfPointsOver200.gvi"(array=w54) -> (NumberOfPointsOverThreshold=w55)
  Is Greater Or Equal(x=w55, y=4) -> w56
  Array Subset(array=w12, index0=19, length0=32) -> w57
  call "NumberOfPointsOver200.gvi"(array=w57) -> (NumberOfPointsOverThreshold=w58)
  Is Greater Or Equal(x=w58, y=4) -> w59
  Logical And(w56, w59) -> w60
  Array Subset(array=w25, index0=9, length0=8) -> w61
  call "NumberOfPointsOver200.gvi"(array=w61) -> (NumberOfPointsOverThreshold=w62)
  Is Greater Or Equal(x=w62, y=4) -> w63
  Array Subset(array=w25, index0=19, length0=32) -> w64
  call "NumberOfPointsOver200.gvi"(array=w64) -> (NumberOfPointsOverThreshold=w65)
  Is Greater Or Equal(x=w65, y=4) -> w66
  Logical And(w63, w66) -> w67
  Array Subset(array=w38, index0=9, length0=8) -> w68
  call "NumberOfPointsOver200.gvi"(array=w68) -> (NumberOfPointsOverThreshold=w69)
  Is Greater Or Equal(x=w69, y=4) -> w70
  Array Subset(array=w38, index0=19, length0=32) -> w71
  call "NumberOfPointsOver200.gvi"(array=w71) -> (NumberOfPointsOverThreshold=w72)
  Is Greater Or Equal(x=w72, y=4) -> w73
  Logical And(w70, w73) -> w74
  Array Subset(array=w51, index0=9, length0=8) -> w75
  call "NumberOfPointsOver200.gvi"(array=w75) -> (NumberOfPointsOverThreshold=w76)
  Is Greater Or Equal(x=w76, y=4) -> w77
  Array Subset(array=w51, index0=19, length0=32) -> w78
  call "NumberOfPointsOver200.gvi"(array=w78) -> (NumberOfPointsOverThreshold=w79)
  Is Greater Or Equal(x=w79, y=4) -> w80
  Logical And(w77, w80) -> w81
  Build Array(w60, w67, w74, w81) -> w82
  $"Far Field" <- w82
