vi "MeasureRinging.gvi"   [LabVIEW NXG 4.0.0]
inputs:
  "session in": "VISA Instr"
  "error in": error
outputs:
  "session out": "VISA Instr"
  "Ringing 6 pulses": i32[]
  "ringing 5 pulses": i32[]
  "ringing 4 pulses": i32[]
  "ringing 3 pulses": i32[]
  "Ringing": bool[]
  "error out": error
  "Echoes for text file": string
uses:
  NI::VISA::Write (Instr, Bytes).gvi
  NI::VISA::Read (Instr, String).gvi
  Kirwan tester::ConditioningCalibrationArray.gvi
  Kirwan tester::NumberOfPointsOver200.gvi
diagram:
  call "Write (Instr, Bytes).gvi"(session in=$"session in", error in=$"error in", write buffer=[0, 85, 10, 88, 6, 40, 16, 23, 4, 1, 144, 95, 119]) -> (session out=w1, error out=w2)
  case (TRUE) {
    frame False, Default {
      w3 = default
      w4 = default
    }
    frame True {
      Wait(time to wait=1100)
      w3 = w1
      w4 = w2
    }
  }
  Property Node(instance in=w3, error in=w4) -> ("ASRL Bytes at Port"=w5, error out=w6, instance out=w7)
  call "Read (Instr, String).gvi"(session in=w7, error in=w6, byte count=w5) -> (session out=w8, error out=w9, read buffer=w10)
  call "Write (Instr, Bytes).gvi"(session in=w8, error in=w9, write buffer=[0, 85, 10, 88, 5, 40, 16, 23, 4, 1, 144, 135, 245]) -> (session out=w11, error out=w12)
  case (TRUE) {
    frame False, Default {
      w13 = default
      w14 = default
    }
    frame True {
      Wait(time to wait=1100)
      w13 = w11
      w14 = w12
    }
  }
  Property Node(instance in=w13, error in=w14) -> ("ASRL Bytes at Port"=w15, error out=w16, instance out=w17)
  call "Read (Instr, String).gvi"(session in=w17, error in=w16, byte count=w15) -> (session out=w18, error out=w19, read buffer=w20)
  call "Write (Instr, Bytes).gvi"(session in=w18, error in=w19, write buffer=[0, 85, 10, 88, 4, 40, 16, 23, 4, 1, 144, 63, 148]) -> (session out=w21, error out=w22)
  case (TRUE) {
    frame False, Default {
      w23 = default
      w24 = default
    }
    frame True {
      Wait(time to wait=1100)
      w23 = w21
      w24 = w22
    }
  }
  Property Node(instance in=w23, error in=w24) -> ("ASRL Bytes at Port"=w25, error out=w26, instance out=w27)
  call "Read (Instr, String).gvi"(session in=w27, error in=w26, byte count=w25) -> (session out=w28, error out=w29, read buffer=w30)
  call "Write (Instr, Bytes).gvi"(session in=w28, error in=w29, write buffer=[0, 85, 10, 88, 3, 40, 16, 24, 4, 1, 144, 242, 62]) -> (session out=w31, error out=w32)
  case (TRUE) {
    frame False, Default {
      w33 = default
      w34 = default
    }
    frame True {
      Wait(time to wait=1100)
      w33 = w31
      w34 = w32
    }
  }
  Property Node(instance in=w33, error in=w34) -> ("ASRL Bytes at Port"=w35, error out=w36, instance out=w37)
  call "Read (Instr, String).gvi"(session in=w37, error in=w36, byte count=w35) -> (session out=w38, error out=w39, read buffer=w40)
  $"session out" <- w38
  $"error out" <- w39
  call "ConditioningCalibrationArray.gvi"(read buffer=w10) -> (CalibrationArray=w41)
  $"Ringing 6 pulses" <- w41
  call "ConditioningCalibrationArray.gvi"(read buffer=w20) -> (CalibrationArray=w42)
  $"ringing 5 pulses" <- w42
  call "ConditioningCalibrationArray.gvi"(read buffer=w30) -> (CalibrationArray=w43)
  $"ringing 4 pulses" <- w43
  call "ConditioningCalibrationArray.gvi"(read buffer=w40) -> (CalibrationArray=w44)
  $"ringing 3 pulses" <- w44
  Array Subset(array=w41, index0=1, length0=5) -> w45
  call "NumberOfPointsOver200.gvi"(array=w45) -> (NumberOfPointsOverThreshold=w46)
  Is Greater Or Equal(x=w46, y=2) -> w47
  Not(x=w47) -> w48
  Array Subset(array=w42, index0=1, length0=5) -> w49
  call "NumberOfPointsOver200.gvi"(array=w49) -> (NumberOfPointsOverThreshold=w50)
  Is Greater Or Equal(x=w50, y=2) -> w51
  Not(x=w51) -> w52
  Array Subset(array=w43, index0=1, length0=5) -> w53
  call "NumberOfPointsOver200.gvi"(array=w53) -> (NumberOfPointsOverThreshold=w54)
  Is Greater Or Equal(x=w54, y=2) -> w55
  Not(x=w55) -> w56
  Array Subset(array=w44, index0=1, length0=5) -> w57
  call "NumberOfPointsOver200.gvi"(array=w57) -> (NumberOfPointsOverThreshold=w58)
  Is Greater Or Equal(x=w58, y=2) -> w59
  Not(x=w59) -> w60
  Build Array(w48, w52, w56, w60) -> w61
  $Ringing <- w61
  Number To Decimal String(number=w41, width (-)=4) -> (decimal integer string=w62)
  Number To Decimal String(number=w42, width (-)=4) -> (decimal integer string=w63)
  Number To Decimal String(number=w43, width (-)=4) -> (decimal integer string=w64)
  Number To Decimal String(number=w44, width (-)=4) -> (decimal integer string=w65)
  Concatenate Strings(w62, "\t", w63, "\t", w64, "\t", w65) -> w66
  $"Echoes for text file" <- w66
