vi "NumberOfPointsOver400.gvi"   [LabVIEW NXG 4.0.0]
inputs:
  "array_2": f64[]
outputs:
  "NumberOfPointsOverThreshold_2": i32
diagram:
  Array Size(array=$array_2) -> (size(s)=w1)
  Is Equal To 0(x=w1) -> w2
  case (w2) {
    frame True {
      w3 = default
    }
    frame False {
      s1 = 0  # shift register
      for {
        w4 = each element of $array_2
        Increment(x=s1) -> w5
        Is Greater(x=w4, y=400) -> w6
        Select(s=w6, t=w5, f=s1) -> w7
        next s1 = w7
      }
      w3 = s1
    }
  }
  $NumberOfPointsOverThreshold_2 <- w3
