vi "PLCCommand.gvi"   [LabVIEW NXG 4.0.0]
inputs:
  "task out": "DAQmx Task"
  "error out": error
outputs:
  "Output": "DAQmx Task"
  "Output_2": error
uses:
  NI::DAQmx::Internal::DAQmx Write (Digital Bool 1Line 1Point).gvi
diagram:
  for (N = 1) {
    call "DAQmx Write (Digital Bool 1Line 1Point).gvi"(task in=$"task out", error in=$"error out", data=TRUE) -> (task out=w1, error out=w2)
    Wait(time to wait=500)
  }
  for (N = 1) {
    call "DAQmx Write (Digital Bool 1Line 1Point).gvi"(task in=w1, error in=w2, data=FALSE) -> (task out=w3, error out=w4)
    Wait(time to wait=500)
  }
  $Output <- w3
  $Output_2 <- w4
