vi "PassFail.gvi"   [LabVIEW NXG 4.0.0]
inputs:
  "Pass/Fail": bool
uses:
  NI::DAQmx::Internal::DAQmx Create Channel (DO-Digital Output).gvi
  NI::DAQmx::Internal::DAQmx Start Task.gvi
  NI::DAQmx::Internal::DAQmx Write (Digital Bool 1Line 1Point).gvi
  NI::DAQmx::Internal::DAQmx Clear Task.gvi
diagram:
  case ($"Pass/Fail") {
    frame False, Default {
      call "DAQmx Create Channel (DO-Digital Output).gvi"(lines="PXI1Slot2/port4/line1") -> (task out=w1, error out=w2)
      call "DAQmx Start Task.gvi"(task in=w1, error in=w2) -> (task out=w3, error out=w4)
      for (N = 1) {
        Wait(time to wait=2000)
        call "DAQmx Write (Digital Bool 1Line 1Point).gvi"(task in=w3, error in=w4, data=TRUE) -> (task out=w5, error out=w6)
      }
      call "DAQmx Write (Digital Bool 1Line 1Point).gvi"(task in=w5, error in=w6, data=FALSE) -> (task out=w7, error out=w8)
      call "DAQmx Clear Task.gvi"(task in=w7, error in=w8)
    }
    frame True {
      call "DAQmx Create Channel (DO-Digital Output).gvi"(lines="PXI1Slot2/port4/line0") -> (task out=w9, error out=w10)
      call "DAQmx Start Task.gvi"(task in=w9, error in=w10) -> (task out=w11, error out=w12)
      for (N = 1) {
        Wait(time to wait=2000)
        call "DAQmx Write (Digital Bool 1Line 1Point).gvi"(task in=w11, error in=w12, data=TRUE) -> (task out=w13, error out=w14)
      }
      call "DAQmx Write (Digital Bool 1Line 1Point).gvi"(task in=w13, error in=w14, data=FALSE) -> (task out=w15, error out=w16)
      call "DAQmx Clear Task.gvi"(task in=w15, error in=w16)
    }
  }
