vi "Read Pass flags.gvi"   [LabVIEW NXG 4.0.0]
inputs:
  "session reference": "VISA Instr"
  "error in": error
outputs:
  "session out": "VISA Instr"
  "error out": error
  "Pass Flags": u8
  "Fail Flags": u8
  "Output": string
  "Boolean": bool
  "Serial Number": u8[]
panel indicators:
  "read buffer": u8[]
uses:
  Kirwan tester::Calculate CRC.gvi
  Kirwan tester::CRC convert to 2 bytes.gvi
  NI::VISA::Write (Instr, Bytes).gvi
  NI::VISA::Read (Instr, Bytes).gvi
diagram:
  Array Subset(array=[0, 85, 5, 62, 240, 8], index0=3) -> w1
  call "Calculate CRC.gvi"(Head status_3=w1) -> (Output_2=w2)
  call "CRC convert to 2 bytes.gvi"(Output=w2) -> (MSB=w3, LSB=w4)
  Build Array([0, 85, 5, 62, 240, 8], w3, w4) -> w5
  call "Write (Instr, Bytes).gvi"(session in=$"session reference", error in=$"error in", write buffer=w5) -> (session out=w6, error out=w7)
  for (N = 1) {
    Wait(time to wait=500)
  }
  Property Node(instance in=w6, error in=w7) -> ("ASRL Bytes at Port"=w8, error out=w9, instance out=w10)
  call "Read (Instr, Bytes).gvi"(session in=w10, error in=w9, byte count=w8) -> (session out=w11, error out=w12, read buffer=w13)
  $"session out" <- w11
  $"error out" <- w12
  Array Index(array=w13) -> (out0[6]=w14, out1[7]=w15)
  case (w14) {
    frame 0 {
      w16 = default
      w17 = "NO Previous tests have passed "
    }
    frame 2, Default {
      w16 = default
      w17 = "Abnormal Test Sequence"
    }
    frame 1 {
      w16 = default
      w17 = "last test passed was ICT"
    }
    frame 3 {
      w16 = default
      w17 = "last test passed was ZeroCal"
    }
    frame 7 {
      w16 = default
      w17 = "last test passed was SmokeCal"
    }
    frame 47 {
      w16 = TRUE
      w17 = "DUT is getting re-tested"
    }
    frame 111 {
      w16 = TRUE
      w17 = "Abnormal Test Sequence"
    }
    frame 15 {
      w16 = TRUE
      w17 = "All Previous tests have passed "
    }
  }
  $Output <- w17
  $"read buffer" <- w13
  $"Pass Flags" <- w14
  $Boolean <- w16
  $"Fail Flags" <- w15
  Array Subset(array=w13, index0=10, length0=4) -> w18
  $"Serial Number" <- w18
