vi "ReadCalData.gvi"   [LabVIEW NXG 4.0.0]
inputs:
  "resource name": "VISA Instr" = "COM25"
  "error in": error
outputs:
  "session out": "VISA Instr"
  "error out_4": error
  "Zero Cal (Dec)": u16
  "Smoke Cal (Dec)": u16
panel indicators:
  "Bytes at Port": u32
  "EEPROM Read Responce": u8[]
  "Smoke Cal Request": u32[]
uses:
  NI::VISA::Open (Instr).gvi
  NI::VISA::Configure Serial Port (Instr).gvi
  NI::VISA::Flush Buffer (Instr).gvi
  Kirwan tester::Calculate CRC.gvi
  Kirwan tester::CRC convert to 2 bytes.gvi
  NI::VISA::Write (Instr, Bytes).gvi
  NI::VISA::Read (Instr, Bytes).gvi
diagram:
  call "Open (Instr).gvi"(resource name=$"resource name", error in=$"error in") -> (session out=w1, error out=w2)
  call "Configure Serial Port (Instr).gvi"(session in=w1, error in=w2, baud rate=19200, enable termination char=FALSE) -> (session out=w3, error out=w4)
  call "Flush Buffer (Instr).gvi"(session in=w3, error in=w4, mode="Discard Receive and Transmit Buffers"(192)) -> (session out=w5, error out=w6)
  Build Array([62], [32, 16]) -> w7
  Array Size(array=w7) -> (size(s)=w8)
  Add(w8, 2) -> w9
  Build Array([0, 85], w9, w7) -> w10
  Array Subset(array=w10, index0=3) -> w11
  call "Calculate CRC.gvi"(Head status_3=w11) -> (Output_2=w12)
  call "CRC convert to 2 bytes.gvi"(Output=w12) -> (MSB=w13, LSB=w14)
  Build Array(w10, w13, w14) -> w15
  call "Write (Instr, Bytes).gvi"(session in=w5, error in=w6, write buffer=w15) -> (session out=w16, error out=w17)
  for (N = 1) {
    Wait(time to wait=1000)
  }
  Property Node(instance in=w16, error in=w17) -> ("ASRL Bytes at Port"=w18, error out=w19, instance out=w20)
  call "Read (Instr, Bytes).gvi"(session in=w20, error in=w19, byte count=w18) -> (session out=w21, error out=w22, read buffer=w23)
  $"session out" <- w21
  $"error out_4" <- w22
  $"EEPROM Read Responce" <- w23
  $"Bytes at Port" <- w18
  $"Smoke Cal Request" <- w15
  Array Index(array=w23) -> (out0[10]=w24)
  Array Index(array=w23) -> (out0[6]=w25)
  Multiply(w25, 256) -> w26: u64
  Add(w26, w24) -> w27
  $"Zero Cal (Dec)" <- w27
  Array Index(array=w23) -> (out0[18]=w28)
  Array Index(array=w23) -> (out0[14]=w29)
  Multiply(w29, 256) -> w30: u64
  Add(w30, w28) -> w31
  $"Smoke Cal (Dec)" <- w31
