vi "ReadSounderEEPROM.gvi"   [LabVIEW NXG 4.0.0]
inputs:
  "session reference": "VISA Instr"
  "error in": error
outputs:
  "read buffer": u8[]
  "session out": "VISA Instr"
  "error out": error
uses:
  Kirwan tester::Calculate CRC.gvi
  Kirwan tester::CRC convert to 2 bytes.gvi
  NI::VISA::Write (Instr, Bytes).gvi
  NI::VISA::Read (Instr, Bytes).gvi
diagram:
  Array Subset(array=[0, 85, 5, 62, 144, 16], index0=3) -> w1
  call "Calculate CRC.gvi"(Head status_3=w1) -> (Output_2=w2)
  call "CRC convert to 2 bytes.gvi"(Output=w2) -> (MSB=w3, LSB=w4)
  Build Array([0, 85, 5, 62, 144, 16], w3, w4) -> w5
  call "Write (Instr, Bytes).gvi"(session in=$"session reference", error in=$"error in", write buffer=w5) -> (session out=w6, error out=w7)
  for (N = 1) {
    Wait(time to wait=1500)
  }
  Property Node(instance in=w6, error in=w7) -> ("ASRL Bytes at Port"=w8, error out=w9, instance out=w10)
  call "Read (Instr, Bytes).gvi"(session in=w10, error in=w9, byte count=w8) -> (session out=w11, error out=w12, read buffer=w13)
  $"session out" <- w11
  $"error out" <- w12
  $"read buffer" <- w13
