vi "TestNewFixtureComms.gvi"   [LabVIEW NXG 4.0.0]
panel controls:
  "BaffleCmd": "DAQmx Physical Channel" = "PXI1Slot2/port4/line2"
  "Alarm Line": "DAQmx Physical Channel" = "PXI1Slot2/port0/line1"
  "Pass Line": "DAQmx Physical Channel" = "PXI1Slot2/port4/line0"
  "Fail Line": "DAQmx Physical Channel" = "PXI1Slot2/port4/line1"
  "BaffleUpACK": "DAQmx Physical Channel" = "PXI1Slot2/port0/line2"
  "stop": bool
  "error in": error
  "task in": "DAQmx Task"
  "BaffleUpACK_3": "DAQmx Physical Channel"
panel indicators:
  "Start of test.": bool
  "Alarm Line_2": bool
  "error out_2": error
  "error out_3": error
  "error out_4": error
  "error out_5": error
  "BaffleInPlace": bool
  "BaffleInPlace_2": bool
  "Pass/Fail": bool
  "Output": string
uses:
  NI::DAQmx::Internal::DAQmx Create Channel (DO-Digital Output).gvi
  NI::DAQmx::Internal::DAQmx Start Task.gvi
  NI::DAQmx::Internal::DAQmx Write (Digital Bool 1Line 1Point).gvi
  NI::DAQmx::Internal::DAQmx Clear Task.gvi
  NI::DAQmx::Internal::DAQmx Create Channel (DI-Digital Input).gvi
  NI::DAQmx::Internal::DAQmx Read (Digital Bool 1Line 1Point).gvi
diagram:
  while {
    call "WaitForStartOfTest.gvi"() -> (error out=w1, Start of test.=w2)
    for (N = 1) {
      case (w2) {
        frame False, Default { }
        frame True {
          for (N = 1) {
            call "DAQmx Create Channel (DO-Digital Output).gvi"(task in=$"task in", error in=$"error in", lines=$BaffleCmd) -> (task out=w4, error out=w5)
            call "DAQmx Start Task.gvi"(task in=w4, error in=w5) -> (task out=w6, error out=w7)
            for (N = 1) {
              call "DAQmx Write (Digital Bool 1Line 1Point).gvi"(task in=w6, error in=w7, data=TRUE) -> (task out=w8, error out=w9)
            }
            call "DAQmx Clear Task.gvi"(task in=w8, error in=w9) -> (error out=w10)
            case (TRUE) {
              frame False, Default {
                w11 = default
                w12 = default
                w13 = default
              }
              frame True {
                for (N = 1) {
                  call "DAQmx Create Channel (DI-Digital Input).gvi"(error in=w10, lines=$BaffleUpACK) -> (task out=w14, error out=w15)
                  call "DAQmx Start Task.gvi"(task in=w14, error in=w15) -> (task out=w16, error out=w17)
                  call "DAQmx Read (Digital Bool 1Line 1Point).gvi"(task in=w16, error in=w17) -> (task out=w12, error out=w11, data=w13)
                  $BaffleInPlace <- w13
                }
              }
            }
            case (w13) {
              frame False, Default {
                w18 = default
              }
              frame True {
                for (N = 1) {
                  Wait(time to wait=3000)
                }
                w18 = TRUE
              }
            }
            call "DAQmx Clear Task.gvi"(task in=w12, error in=w11)
            append $BaffleCmd to w3
            stop if w18
          }
          case (w18) {
            frame False, Default {
              w19 = default
            }
            frame True {
              for (N = 1) {
                w20 = each element of w3
                call "DAQmx Create Channel (DO-Digital Output).gvi"(lines=w20) -> (task out=w21, error out=w22)
                call "DAQmx Start Task.gvi"(task in=w21, error in=w22) -> (task out=w23, error out=w24)
                for (N = 1) {
                  call "DAQmx Write (Digital Bool 1Line 1Point).gvi"(task in=w23, error in=w24, data=FALSE) -> (task out=w25, error out=w26)
                }
                case (FALSE) {
                  frame False, Default {
                    w27 = w26
                    w28 = w25
                  }
                  frame True {
                    for (N = 1) {
                      call "DAQmx Create Channel (DI-Digital Input).gvi"(task in=w25, error in=w26, lines=$BaffleUpACK_3) -> (task out=w29, error out=w30)
                      call "DAQmx Start Task.gvi"(task in=w29, error in=w30) -> (task out=w31, error out=w32)
                      call "DAQmx Read (Digital Bool 1Line 1Point).gvi"(task in=w31, error in=w32) -> (task out=w28, error out=w27, data=w33)
                      $BaffleInPlace_2 <- w33
                    }
                  }
                }
                call "DAQmx Clear Task.gvi"(task in=w28, error in=w27) -> (error out=w34)
                case (w34) {
                  frame Error, Default {
                    w19 = default
                  }
                  frame No Error {
                    for (N = 1) {
                      Wait(time to wait=3000)
                    }
                    w19 = TRUE
                  }
                }
                stop if w19
              }
            }
          }
          case (w19) {
            frame False, Default { }
            frame True {
              for (N = 1) {
                call "DAQmx Create Channel (DI-Digital Input).gvi"(lines=$"Alarm Line") -> (task out=w35, error out=w36)
                call "DAQmx Start Task.gvi"(task in=w35, error in=w36) -> (task out=w37, error out=w38)
                call "DAQmx Read (Digital Bool 1Line 1Point).gvi"(task in=w37, error in=w38) -> (task out=w39, error out=w40, data=w41)
                Not(x=w41) -> w42
                case (w42) {
                  frame False, Default {
                    call "DAQmx Create Channel (DO-Digital Output).gvi"(lines=$"Fail Line") -> (task out=w44, error out=w45)
                    call "DAQmx Start Task.gvi"(task in=w44, error in=w45) -> (task out=w46, error out=w47)
                    for (N = 1) {
                      call "DAQmx Write (Digital Bool 1Line 1Point).gvi"(task in=w46, error in=w47, data=TRUE) -> (task out=w48, error out=w49)
                      Wait(time to wait=1000)
                    }
                    call "DAQmx Write (Digital Bool 1Line 1Point).gvi"(task in=w48, error in=w49, data=FALSE) -> (task out=w50, error out=w51)
                    call "DAQmx Clear Task.gvi"(task in=w50, error in=w51) -> (error out=w52)
                    $"error out_4" <- w52
                    w43 = FALSE
                  }
                  frame True {
                    call "DAQmx Create Channel (DO-Digital Output).gvi"(lines=$"Pass Line") -> (task out=w53, error out=w54)
                    call "DAQmx Start Task.gvi"(task in=w53, error in=w54) -> (task out=w55, error out=w56)
                    for (N = 1) {
                      call "DAQmx Write (Digital Bool 1Line 1Point).gvi"(task in=w55, error in=w56, data=TRUE) -> (task out=w57, error out=w58)
                      Wait(time to wait=1000)
                    }
                    call "DAQmx Write (Digital Bool 1Line 1Point).gvi"(task in=w57, error in=w58, data=FALSE) -> (task out=w59, error out=w60)
                    call "DAQmx Clear Task.gvi"(task in=w59, error in=w60) -> (error out=w61)
                    $"error out_3" <- w61
                    w43 = TRUE
                  }
                }
                $"Pass/Fail" <- w43
                call "DAQmx Clear Task.gvi"(task in=w39, error in=w40) -> (error out=w62)
                $"error out_2" <- w62
                $"Alarm Line_2" <- w41
                case (w41) {
                  frame False, Default {
                    w63 = default
                  }
                  frame True {
                    w63 = "Light curtain broken during test.\nTest not valid."
                  }
                }
                $Output <- w63
              }
            }
          }
        }
      }
    }
    $"Start of test." <- w2
    $"error out_5" <- w1
    stop if $stop
  }
