vi "ToggleRelays.gvi"   [LabVIEW NXG 4.0.0]
panel controls:
  "channel": "DAQmx Physical Channel" = "PXI1Slot5/port4/line0"
  "Relay": bool
  "stop": bool
uses:
  NI::DAQmx::Internal::DAQmx Create Channel (DO-Digital Output).gvi
  NI::DAQmx::Internal::DAQmx Start Task.gvi
  NI::DAQmx::Internal::DAQmx Write (Digital Bool 1Line 1Point).gvi
  NI::DAQmx::Internal::DAQmx Clear Task.gvi
diagram:
  while {
    call "DAQmx Create Channel (DO-Digital Output).gvi"(lines=$channel) -> (task out=w1, error out=w2)
    call "DAQmx Start Task.gvi"(task in=w1, error in=w2) -> (task out=w3, error out=w4)
    call "DAQmx Write (Digital Bool 1Line 1Point).gvi"(task in=w3, error in=w4, data=$Relay) -> (task out=w5, error out=w6)
    call "DAQmx Clear Task.gvi"(task in=w5, error in=w6)
    stop if $stop
  }
