vi "VaildateUserID.gvi"   [LabVIEW NXG 4.0.0]
inputs:
  "session in": "VISA Instr"
  "error in": error
  "Bytes>10": bool
  "pass flags": bool = TRUE
  "byte count": u32 = 11
outputs:
  "session out": "VISA Instr"
  "UserIDValid": bool
  "User ID": u8[]
  "error out": error
  "PassFlags": bool
uses:
  NI::VISA::Read (Instr, Bytes).gvi
  NI::VISA::Write (Instr, Bytes).gvi
  NI::G Core::Error::Clear Error Cluster.gvi
diagram:
  case ($"Bytes>10") {
    frame False, Default {
      w1 = default
      w2 = default
    }
    frame True {
      call "Read (Instr, Bytes).gvi"(session in=$"session in", error in=$"error in", byte count=$"byte count") -> (session out=w3, error out=w4, read buffer=w5)
      Array Size(array=w5) -> (size(s)=w6)
      Is Greater Or Equal(x=w6, y=6) -> w1
      case (w1) {
        frame False, Default {
          w7 = w3
          w8 = w4
        }
        frame True {
          call "Write (Instr, Bytes).gvi"(session in=w3, error in=w4, write buffer=[0, 85, 3, 84, 251, 129]) -> (session out=w7, error out=w8)
        }
      }
      $"session out" <- w7
      call "Clear Error Cluster.gvi"(error in=w8) -> (error out=w9)
      $"error out" <- w9
      $"User ID" <- w5
      w2 = $"pass flags"
    }
  }
  $UserIDValid <- w1
  $PassFlags <- w2
