vi "WaitForStartOfTest.gvi"   [LabVIEW NXG 4.0.0]
inputs:
  "Simulate start of test": bool
outputs:
  "Start of test.": bool
  "error out": error
  "Output": ByteStreamFileRefnum
  "Midnight=TRUE": bool
  "Initialisation Vector": u32
  "loop iteration": i32
panel indicators:
  "error out_2": error
  "time string": string
uses:
  NI::DAQmx::Internal::DAQmx Create Channel (DI-Digital Input).gvi
  NI::DAQmx::Internal::DAQmx Start Task.gvi
  NI::DAQmx::Internal::DAQmx Read (Digital Bool 1Line 1Point).gvi
  NI::DAQmx::Internal::DAQmx Clear Task.gvi
  NI::G Core::Error::Multiplex Errors.gvi
diagram:
  # Start of test signal.
  call "DAQmx Create Channel (DI-Digital Input).gvi"(lines="PXI1Slot2/port0/line0") -> (task out=w1, error out=w2)
  call "DAQmx Start Task.gvi"(task in=w1, error in=w2) -> (task out=w3, error out=w4)
  # Alarm Signal.
  call "DAQmx Create Channel (DI-Digital Input).gvi"(lines="PXI1Slot2/port0/line1") -> (task out=w5, error out=w6)
  call "DAQmx Start Task.gvi"(task in=w5, error in=w6) -> (task out=w7, error out=w8)
  s1 = uninitialised  # shift register
  while (iteration -> i1) {
    call "DAQmx Read (Digital Bool 1Line 1Point).gvi"(task in=w3, error in=w4) -> (task out=w9, error out=w10, data=w11)
    Logical Or(w11, $"Simulate start of test") -> w12
    # If alarm is High at  this stage there is a machine fault.
    call "DAQmx Read (Digital Bool 1Line 1Point).gvi"(task in=w7, error in=w8) -> (task out=w13, error out=w14, data=w15)
    case (w15) {
      frame False, Default { }
      frame True {
        One Button Dialog(message="Machine Fault! \nContact maintenance ")
      }
    }
    Wait(time to wait=300)
    $"Initialisation Vector" <- s1
    Is Equal To 0(x=s1) -> w16
    Get Current Time() -> (current time=w17)
    Get Date And Time String(time stamp=w17, want seconds? (F)=TRUE) -> (time string=w18)
    Is Equal(x=w18, y="00:00:10") -> w19
    Logical Or(w16, w19) -> w20
    Feedback Node(input=w21) -> w22
    case (w20) {
      frame False, Default {
        w21 = w22
      }
      frame True {
        case (w20) {
          frame False { }
          frame True {
            Wait(time to wait=2000)
          }
        }
        Get Current Time() -> (current time=w23)
        Format Date Time String(time format string (%c)="%d%m%y_%H%M%S", time stamp=w23) -> (date/time string=w24)
        Concatenate Strings(w24, ".csv") -> w25
        Build Path(base path=path "C:\\UltraCal", name or relative path=w25) -> (appended path=w26)
        Open Or Create Or Replace File(access (0:read/write)="read/write", file path (use dialog)=w26, operation (0:open)="open or create") -> (error out=w27, refnum out=w28)
        w29 = "APP Version,DateTime,Serial Number (Head),Test Status,Cycle Time, Ringing Time(ms),Calibrated Pulses, Test Value"
        Concatenate Strings(w29, "\r\n") -> w30
        Write To Text File(error in=w27, file (use dialog)=w28, text=w30) -> (error out=w31, refnum out=w21)
        $"error out_2" <- w31
      }
    }
    Add(s1, 1) -> w32
    $"time string" <- w18
    $"loop iteration" <- i1
    next s1 = w32
    stop if w12
  }
  $"Start of test." <- w12
  call "DAQmx Clear Task.gvi"(task in=w13, error in=w14) -> (error out=w33)
  call "DAQmx Clear Task.gvi"(task in=w9, error in=w10) -> (error out=w34)
  call "Multiplex Errors.gvi"(error in 1=w34, error in 2=w33) -> (error out=w35)
  $"error out" <- w35
  $Output <- w21
  $"Midnight=TRUE" <- w19
