vi "bring up bed of nails.gvi"   [LabVIEW NXG 4.0.0]
inputs:
  "Physical Channel reference": "DAQmx Physical Channel"
  "task in": "DAQmx Task"
  "error in": error
outputs:
  "error out": error
  "task out": "DAQmx Task"
uses:
  NI::DAQmx::Internal::DAQmx Create Channel (DO-Digital Output).gvi
  NI::DAQmx::Internal::DAQmx Start Task.gvi
  NI::DAQmx::Internal::DAQmx Write (Digital Bool 1Line 1Point).gvi
diagram:
  call "DAQmx Create Channel (DO-Digital Output).gvi"(task in=$"task in", error in=$"error in", lines=$"Physical Channel reference") -> (task out=w1, error out=w2)
  call "DAQmx Start Task.gvi"(task in=w1, error in=w2) -> (task out=w3, error out=w4)
  call "DAQmx Write (Digital Bool 1Line 1Point).gvi"(task in=w3, error in=w4, data=TRUE) -> (task out=w5, error out=w6)
  $"task out" <- w5
  $"error out" <- w6
