vi "reader sounder test status.gvi"   [LabVIEW NXG 4.0.0]
panel controls:
  "UART COM": "VISA Instr" = "COM3"
  "stop": bool
  "Bed of nails down": "DAQmx Physical Channel" = "Dev1/port0/line1"
  "Bed of nails": "DAQmx Physical Channel" = "Dev1/port0/line1"
  "Device reset": "DAQmx Physical Channel" = "Dev1/port0/line2"
  "Button": bool
panel indicators:
  "Test Mode ACK": bool
  "loop iteration": i32
  "read buffer_2": u8[]
  "TestModeACK": error
  "Test Status": string
  "Progress Bar": f64
  "Test In Progress": bool
  "loop iteration_2": i32
  "EEPROM Data": u8[]
  "Result": bool
  "subarray": u8[]
  "error out": error
  "User ID": u8[]
  "User ID Recieved": bool
uses:
  Kirwan tester::Generate .csv file from timestamp.gvi
  NI::VISA::Open (Instr).gvi
  NI::VISA::Configure Serial Port (Instr).gvi
  NI::VISA::Flush Buffer (Instr).gvi
  Kirwan tester::bring down bed of nails.gvi
  NI::DAQmx::Internal::DAQmx Clear Task.gvi
  Kirwan tester::bring up bed of nails.gvi
  Kirwan tester::reset device.gvi
  NI::VISA::Read (Instr, Bytes).gvi
  NI::G Core::Error::Filter Error Code.gvi
  NI::VISA::Write (Instr, Bytes).gvi
  Kirwan tester::Confirm test mode entry ack.gvi
  Kirwan tester::ReadSounderEEPROM.gvi
diagram:
  call "Generate .csv file from timestamp.gvi"(File Path=path "C:\\UltraCal") -> (Output=w1)
  while (iteration -> i1) {
    $"Test In Progress" <- TRUE
    $"Test Mode ACK" <- FALSE
    for (N = 1) {
      $"Progress Bar" <- 0
      call "Open (Instr).gvi"(resource name=$"UART COM") -> (session out=w2, error out=w3)
      call "Configure Serial Port (Instr).gvi"(session in=w2, error in=w3, baud rate=19200, timeout=10000, enable termination char=FALSE) -> (session out=w4, error out=w5)
      call "Flush Buffer (Instr).gvi"(session in=w4, error in=w5, mode="Discard Receive and Transmit Buffers"(192)) -> (session out=w6, error out=w7)
      while (iteration -> i2) {
        Is Equal To 0(x=i2) -> w8
        case (w8) {
          frame False, Default {
            w9 = w7
          }
          frame True {
            call "bring down bed of nails.gvi"(lines=$"Bed of nails down") -> (task out=w10)
            call "DAQmx Clear Task.gvi"(task in=w10, error in=w7) -> (error out=w9)
          }
        }
        case ($Button) {
          frame False, Default {
            w11 = w9
          }
          frame True {
            call "bring up bed of nails.gvi"(Physical Channel reference=$"Bed of nails") -> (task out=w12, error out=w13)
            for (N = 1) {
              call "DAQmx Clear Task.gvi"(task in=w12)
              Wait(time to wait=2000)
            }
            call "reset device.gvi"(error in=w13, Physical Channel reference=$"Device reset") -> (task out=w14, error out=w15)
            call "DAQmx Clear Task.gvi"(task in=w14, error in=w15) -> (error out=w11)
            $subarray <- u8[] []
          }
        }
        Property Node(instance in=w6) -> ("ASRL Bytes at Port"=w16, instance out=w17)
        Is Greater(x=w16, y=10) -> w18
        case (w18) {
          frame False, Default {
            w19 = default
            w20 = w11
            w21 = w17
          }
          frame True {
            call "Read (Instr, Bytes).gvi"(session in=w17, error in=w11, byte count=11) -> (session out=w22, error out=w23, read buffer=w24)
            $"error out" <- w23
            Array Size(array=w24) -> (size(s)=w25)
            Is Greater Or Equal(x=w25, y=4) -> w19
            call "Filter Error Code.gvi"(error in=w23, code to clear=-1073807298) -> (error out=w26)
            case (w19) {
              frame False, Default {
                w20 = w26
                w21 = w22
              }
              frame True {
                call "Write (Instr, Bytes).gvi"(session in=w22, error in=w26, write buffer=[0, 85, 3, 84, 251, 129]) -> (session out=w21, error out=w20)
              }
            }
            $"User ID" <- w24
          }
        }
        call "Filter Error Code.gvi"(error in=w20, code to clear=-1073807253) -> (error out=w27)
        $"User ID Recieved" <- w19
        stop if w19
      }
      case (w19) {
        frame False, Default {
          w28 = default
          w29 = w21
          w30 = w19
        }
        frame True {
          for (N = 1) {
            Wait(time to wait=500)
          }
          while (iteration -> i3) {
            call "Confirm test mode entry ack.gvi"(error in=w27, session in=w21) -> (session out=w29, error out=w28, logical AND=w31, read buffer=w32)
            $TestModeACK <- w28
            $"read buffer_2" <- w32
            $"Test Mode ACK" <- w31
            Is Greater Than 0(x=i3) -> w33
            Logical Or(w31, w33) -> w34
            case (w34) {
              frame False, Default {
                w30 = default
              }
              frame True {
                w30 = w31
              }
            }
            $"loop iteration" <- i3
            stop if w34
          }
        }
      }
      case (w30) {
        frame True {
          case (TRUE) {
            frame True { }
            frame False {
              while {
                Wait(time to wait=1000)
                One Button Dialog(button name ("OK")="ACK FAIL", message="UNIT HAS FAILED. ") -> (true=w36)
                stop if w36
              }
            }
          }
          call "ReadSounderEEPROM.gvi"(session reference=w29, error in=w28) -> (session out=w37, error out=w38, read buffer=w39)
          Array Index(array=w39) -> (out0[9]=w40)
          Is Not Equal To 0(x=w40)
          $"EEPROM Data" <- w39
          Number To Hexadecimal String(number=w39, width (-)=2) -> (hex integer string=w35)
          $"Progress Bar" <- 1
        }
        frame False {
          w35 = default
        }
      }
      Concatenate Strings(w35, "\r\n") -> w41
      case (TRUE) {
        frame False, Default { }
        frame True {
          Write To Text File(file (use dialog)=w1, text=w41)
        }
      }
    }
    Is Equal To 0(x=i1) -> w42
    case (w42) {
      frame False, Default { }
      frame True {
        $"Test Status" <- ""
      }
    }
    $"loop iteration_2" <- i1
    stop if $stop
  }
