vi "reset device.gvi"   [LabVIEW NXG 4.0.0]
inputs:
  "task in": "DAQmx Task"
  "error in": error
  "Physical Channel reference": "DAQmx Physical Channel"
outputs:
  "task out": "DAQmx Task"
  "error out": error
uses:
  NI::DAQmx::Internal::DAQmx Create Channel (DO-Digital Output).gvi
  NI::DAQmx::Internal::DAQmx Start Task.gvi
  NI::DAQmx::Internal::DAQmx Write (Digital Bool 1Line 1Point).gvi
diagram:
  call "DAQmx Create Channel (DO-Digital Output).gvi"(task in=$"task in", error in=$"error in", lines=$"Physical Channel reference") -> (task out=w1, error out=w2)
  call "DAQmx Start Task.gvi"(task in=w1, error in=w2) -> (task out=w3, error out=w4)
  for (N = 1) {
    Wait(time to wait=150)
    call "DAQmx Write (Digital Bool 1Line 1Point).gvi"(task in=w3, error in=w4, data=TRUE) -> (task out=w5, error out=w6)
  }
  call "DAQmx Write (Digital Bool 1Line 1Point).gvi"(task in=w5, error in=w6, data=FALSE) -> (task out=w7, error out=w8)
  $"task out" <- w7
  $"error out" <- w8
