vi "toggle relays.gvi"   [LabVIEW NXG 4.0.0]
panel controls:
  "To PLC": "DAQmx Physical Channel"
  "data": bool
  "stop": bool
  "From PLC": "DAQmx Physical Channel"
panel indicators:
  "data_2": bool
  "error out": error
  "error out_2": error
uses:
  NI::DAQmx::Internal::DAQmx Create Channel (DO-Digital Output).gvi
  NI::DAQmx::Internal::DAQmx Start Task.gvi
  NI::DAQmx::Internal::DAQmx Write (Digital Bool 1Line 1Point).gvi
  NI::DAQmx::Internal::DAQmx Clear Task.gvi
  NI::DAQmx::Internal::DAQmx Create Channel (DI-Digital Input).gvi
  NI::DAQmx::Internal::DAQmx Read (Digital Bool 1Line 1Point).gvi
diagram:
  while {
    Wait(time to wait=1000)
    call "DAQmx Create Channel (DO-Digital Output).gvi"(lines=$"To PLC") -> (task out=w1, error out=w2)
    call "DAQmx Start Task.gvi"(task in=w1, error in=w2) -> (task out=w3, error out=w4)
    call "DAQmx Write (Digital Bool 1Line 1Point).gvi"(task in=w3, error in=w4, data=$data) -> (task out=w5, error out=w6)
    call "DAQmx Clear Task.gvi"(task in=w5, error in=w6) -> (error out=w7)
    $"error out" <- w7
    call "DAQmx Create Channel (DI-Digital Input).gvi"(lines=$"From PLC") -> (task out=w8, error out=w9)
    call "DAQmx Start Task.gvi"(task in=w8, error in=w9) -> (task out=w10, error out=w11)
    call "DAQmx Read (Digital Bool 1Line 1Point).gvi"(task in=w10, error in=w11) -> (task out=w12, error out=w13, data=w14)
    call "DAQmx Clear Task.gvi"(task in=w12, error in=w13) -> (error out=w15)
    $"error out_2" <- w15
    $data_2 <- w14
    stop if $stop
  }
